# Grasshopper definition Cpython_test_1.gh (Grasshopper 1.0.7)
# plug-ins: Hops

pt = Point(<point referenced from the Rhino model>)
cir = Circle(Plane=pt, Radius=Slider(10, range=0..10))
hops = Hops(
    Curve=cir,
    T=Slider(12, range=0..30),
    CacheResultsInMemory=False,
    CacheSolveResults=False,
    RemoteDefinitionLocation="http://127.0.0.1:5000/pointat",
    RemoteSolveVersion=(0, 1, 0),
    ShowInput_Enabled=False,
    ShowInput_Path=False,
    SynchronousSolve=True)
panel = Panel("https://github.com/mcneel/compute.rhino3d/tree/master/src/ghhops-server-py/examples")
openwwlink = CSharpScript(URL=panel, ClickMe=Toggle(False))  # -> out, A; inputs URL: String, ClickMe: Boolean; disabled
# ---------- openwwlink: C# ----------
    System.Diagnostics.Process.Start(URL);
# ---------- end openwwlink ----------
