# Grasshopper definition HOPS_SpacePlanning.gh (Grasshopper 1.0.7)
# plug-ins: Hops

panel = Panel("""Black
Red
Blue
Gold
Green
Orange
purple
Brown
Purple
Cyan""")
path = FilePath("C:\Users\ARanade\OneDrive - NBBJ LP\Desktop\TestData SpacePlanning.xlsx")
hops = Hops(
    GetBoolean=Toggle(True),
    GetFilePath=path,
    GetString="Sheet1",
    GetColor=panel,
    CacheResultsInMemory=True,
    CacheSolveResults=True,
    RemoteDefinitionLocation="C:\Users\ARanade\OneDrive - NBBJ LP\00_DC_Scripts\SimpleRectangle_Space Planning_1.gh",
    RemoteSolveVersion=(0, 1, 0),
    ShowInput_Enabled=False,
    ShowInput_Path=False,
    SynchronousSolve=True)  # -> Point, Name, Color, Rect
panel_2 = Panel(hops.Rect)
