# Grasshopper definition Hops_Simple_Test.gh (Grasshopper 1.0.7)

pt = Point([Point(12.36630439, -23.5991571, 0), Point(-33.3247115, 8.322769899, 0), Point(10.91585743, 30.5054825, 0), Point(41.41639791, 3.763101906, 0)])
points = GetPoint(pt, AtLeast=3, AtMost=10, Realtime=True)
del = DelaunayMesh(Points=points, Plane=PlaneXY(0, 0, 0))

# ---- group: RH_OUT:pts
pt_2 = Point(points)

# ---- group: RH_OUT:m
mesh = Mesh(del)
